# Grasshopper definition test_hops.gh (Grasshopper 1.0.7)
# plug-ins: Hops

input = DataInput(
    Destination="C:\Users\casas\OneDrive\Escritorio\Projects-In Progress\APPS\app-sd-facades\gis\data_test_hops.ghdata",
    RelativePath="C:\Users\casas\OneDrive\Escritorio\Projects-In Progress\APPS\app-sd-facades\gis\data_test_hops.ghdata|..\gis\data_test_hops.ghdata",
    UpdateDelay=5)  # -> city, localid, facade_area, roof_area, batchid
tstat = TreeStatistics(Tree=input.city)  # -> Paths, Length, Count
split = SplitList(List=tstat.Paths, Index=3)  # -> ListA, ListB
split_2 = SplitTree(Data=input.city, Masks=flatten(split.ListA))  # -> Positive, Negative
split_3 = SplitTree(Data=input.localid, Masks=flatten(split.ListA))  # -> Positive, Negative
split_4 = SplitTree(Data=input.facade_area, Masks=flatten(split.ListA))  # -> Positive, Negative
split_5 = SplitTree(Data=input.roof_area, Masks=flatten(split.ListA))  # -> Positive, Negative
split_6 = SplitTree(Data=input.batchid, Masks=flatten(split.ListA))  # -> Positive, Negative
hops = Hops(
    _Enabled=True,
    City=split_2.Positive,
    Local_id=split_3.Positive,
    Facade_area=split_4.Positive,
    Roof_area=split_5.Positive,
    Batch_id=split_6.Positive,
    CacheResultsInMemory=False,
    CacheSolveResults=False,
    RemoteDefinitionLocation="http://192.168.1.164:5000/send",
    RemoteSolveVersion=(0, 1, 0),
    ShowInput_Enabled=True,
    ShowInput_Path=False,
    SynchronousSolve=True)
panel = Panel(hops)

# ---- group: Export to database
panel_2 = Panel("general_building_data")
panel_3 = Panel("""id SERIAL PRIMARY KEY
city
local_id
facade_area
roof_area
batch_id""")
panel_4 = Panel()
addition = Addition(A=panel_4, B=1)
create_query = CreateQuery(pg_squema="city_simulations.", pg_tables=panel_2, fields=panel_3, insert_batch=addition)  # -> pg_tables_2, query_sql, drop, display_query

# ----
path = FilePath("C:\Users\computeretsa_user\OneDrive - UNIVERSIDAD SAN JORGE\fachadas-batch\grasshopper\credentials.txt")
bool = Boolean()
hops_2 = Hops(
    Query_sql=create_query.query_sql,
    CacheResultsInMemory=True,
    CacheSolveResults=True,
    RemoteDefinitionLocation="http://127.0.0.1:5000/execute_query",
    RemoteSolveVersion=(0, 1, 0),
    ShowInput_Enabled=True,
    ShowInput_Path=False,
    SynchronousSolve=True)
insert_query = InsertQueryLOCAL(
    credentials=path,
    activate=bool,
    pg_database="postgres",
    pg_tables=panel_2,
    query_sql=create_query.query_sql,
    drop=create_query.drop)  # -> out, con, query, sql_query
# ---------- insert_query: Python ----------
# https://www.tutorialspoint.com/python_data_access/python_postgresql_create_table.htm
# https://www.tutorialspoint.com/postgresql/postgresql_python.htm
# https://www.tutorialspoint.com/python_postgresql/python_postgresql_create_table.htm
# https://www.tutorialspoint.com/python_postgresql/python_postgresql_insert_data.htm



# %% [markdown]
#1 Import psycopg2 desde grasshopper, añadir credenciales y conectarse

import scriptcontext as sc
psycopg2 = sc.sticky['psycopg2']
# import psycopg2

#read credentials file
credentials_file = []
with open(credentials) as f:
    lines = f.read()
    lines=lines.split('\n')
    for line in lines:
        parts = line.split('=')
        credentials_file.append(parts[1][1:-1])





PGHOST=credentials_file[0]
PGDATABASE=pg_database  #input de grasshopper
PGUSER=credentials_file[1]
PGPASSWORD=credentials_file[2]

# Set up a connection to the postgres server.
conn_string = "host="+ PGHOST +" port="+ "5432" +" dbname="+ PGDATABASE +" user=" + PGUSER \
+" password="+ PGPASSWORD


if activate==False:
    conn=psycopg2.connect(conn_string)
    con=str(conn)
    print("Connected!")
    
    
    #Setting auto commit false
    conn.autocommit = True
    
    
    # %% [markdown]
    
    cursor = conn.cursor()
    
    # inputs de grasshopper
    if drop==True:
        cursor.execute("DROP TABLE IF EXISTS " + str(pg_tables))    #create or update table
    else:
        pass
    
    
    cursor.execute(query_sql)   #execute query
    
    
    # Commit all and closing the connection
    conn.commit()
    
    cursor.close()
    conn.close()

else:
    pass
# ---------- end insert_query ----------

# ==== cluster CreateQuery
insert_batch = ClusterInput()
pg_squema = ClusterInput()
pg_tables = ClusterInput()
fields = ClusterInput()
values = ClusterInput()

equals = Equality(FirstNumber=insert_batch, SecondNumber=0)  # -> Equality, Inequality
filter = StreamFilter(Gate=equals.Equality, Stream0=Toggle(True), Stream1=Toggle(False))
invbool = InvertBoolean(Boolean=filter)  # -> Inverted, Number

python = GhPythonScript(x=insert_batch)  # -> out, a
# ---------- python: Python ----------
__author__ = "casas"
__version__ = "2022.12.07"

import rhinoscriptsyntax as rs
import datetime


now = datetime.datetime.now()
time_string = now.strftime("%Y-%m-%d %H:%M:%S")
print(x)
a=time_string
# ---------- end python ----------
item = ListItem(List=values, Index=0, Wrap=True)
dup = DuplicateDataMatchR6(SourceDataTree=item, SecondaryData1=python.a)  # -> SourceData, SecondaryData1
match = MatchTree(Tree=dup.SecondaryData1, Guide=values)
merge = Merge(Data1=values, Data2=match)

columnparam = SQLColumnParameters(ColumnName=fields, DataType="varchar", PrimaryKey=False, NotNull=False, AutoIncrement=False)
sqlformatrows = SQLFormatRows(RowDataList=merge)
concat = Concatenate(FragmentA=pg_squema, FragmentB=pg_tables)
createtb = SQLCreateTable(TableName=concat, Columns=flatten(columnparam), DropTable=False, Connector="PostgreSQL")
insert = SQLInsertCommand(Table=concat, Columns=fields, Data=sqlformatrows, Update=False, Connector="PostgreSQL")
flatten = FlattenTree(Tree=insert, Path="{0}")

launchapp = LaunchApplication(LaunchToggle=Toggle(True), ApplicationPath="F:\Recursos\Construction-Hops\Database\hops_postgres.py")

number_slider = Slider(2, range=0..10)
tstat = TreeStatistics(Tree=flatten)  # -> Paths, Length, Count
subtraction = Subtraction(A=tstat.Length, B=number_slider)
filter_2 = StreamFilter(Gate=filter, Stream0=createtb)
split = SplitList(List=flatten, Index=number_slider)  # -> ListA, ListB
# la estrucutra de datos cada branch tiene que tener el mismo número de fields
split_2 = SplitList(List=flatten, Index=subtraction)  # -> ListA, ListB
merge_2 = Merge(Data1=filter_2, Data2=split.ListA, Data3=split_2.ListB)  # -> flatten(Result)

join = TextJoin(Text=flatten, Join=";")
entwine = Entwine(Branch00=createtb, Branch01=join, FlattenInputs=True)
filter_3 = StreamFilter(Gate=filter, Stream0=entwine, Stream1=join)
join_2 = TextJoin(Text=flatten(filter_3))

series = Series(Start=50, Step=1, Count=10)  # disabled
item_2 = ListItem(List=flatten, Index=series, Wrap=True)  # disabled
panel = Panel(item_2)  # disabled
display_query = ClusterOutput(merge_2)
pg_tables_2 = ClusterOutput(concat)
query_sql = ClusterOutput(join_2)
drop = ClusterOutput(invbool.Inverted)
