# Grasshopper definition facades_analysis_generic.gh (Grasshopper 1.0.7)
# plug-ins: Urbano, CORE.Toolbox.Grasshopper, treesloth01, Sasquatch, EleFront, LunchBoxML, Speckle 2, MeshEdit Components, TT Toolbox, eleFront, Parakeet, Impala, Pufferfish, Hops, Eddy3D, Human, LunchBox

done = Panel("0, 1, 2, 3")

path = FilePath("F:\Recursos\GIS\Logroño\ESP_RI_Logrono-Agoncillo.AP.080840_TMYx\ESP_RI_Logrono-Agoncillo.AP.080840_TMYx.epw")
panel = Panel(path)
importepw = LBImportEPW(epw_file=path)  # -> location, dry_bulb_temperature, dew_point_temperature, relative_humidity, wind_speed, wind_direction, direct_normal_rad, diffuse_horizontal_rad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; plug-in component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
analysisperiod = LBAnalysisPeriod(start_month=1, start_day=1, start_hour=0)  # -> period, hoys, dates; plug-in component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
skymatrix = LBCumulativeSkyMatrix(
    location=importepw.location,
    direct_rad=importepw.direct_normal_rad,
    diffuse_rad=importepw.diffuse_horizontal_rad,
    hoys=analysisperiod.hoys)  # -> report, sky_mtx; plug-in component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
panel_2 = Panel(skymatrix.sky_mtx)

merge = Merge(Data1=Slider(0, range=0..24), Data2=Slider(12, range=0..24), Data3=Slider(17, range=0..24))
shift = ShiftList(List=merge, Shift=1, Wrap=True)
analysisperiod_2 = LBAnalysisPeriod(start_month=1, start_day=1, start_hour=merge, end_hour=shift)  # -> period, hoys, dates; plug-in component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
skymatrix_2 = LBCumulativeSkyMatrix(
    location=importepw.location,
    direct_rad=importepw.direct_normal_rad,
    diffuse_rad=importepw.diffuse_horizontal_rad,
    hoys=analysisperiod_2.hoys)  # -> report, sky_mtx; plug-in component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

panel_3 = Panel("""#FFCC70
#FFFADD
#8ECDDD
#22668D""")
swatch = ColourSwatch(SwatchColor=RGB(255, 255, 255))
range = Range(Domain=Domain(0, 1), Steps=10)
gradient = Gradient(
    LowerLimit=0,
    UpperLimit=1,
    Parameter=range,
    stops=[0: RGB(0, 0, 0), 0.0312: RGB(6, 6, 9), 0.0625: RGB(13, 13, 19), 0.0938: RGB(20, 20, 29), 0.125: RGB(27, 27, 38), 0.156: RGB(34, 34, 48)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])
legendpar = LBLegendParameters(colors=reverse(gradient))  # -> leg_par; plug-in component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
col = Colour(panel_3)
interpolate_color = InterpolateColor(Colors=reverse(col), InterpolationParameters=range)
gradient_2 = Gradient(
    LowerLimit=0,
    UpperLimit=1,
    Parameter=range,
    stops=[0: RGB(48, 18, 59), 0.0312: RGB(57, 41, 114), 0.0625: RGB(64, 64, 161), 0.0938: RGB(68, 86, 199), 0.125: RGB(70, 107, 227), 0.156: RGB(70, 127, 246)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])
legend = Legend(Colour=interpolate_color, Tags=["One Fish", "Two Fish", "Red Fish", "Blue Fish"], LegendType=1)
gradient_3 = Gradient(
    LowerLimit=0,
    UpperLimit=1,
    Parameter=range,
    stops=[0: RGB(0, 0, 3), 0.0312: RGB(3, 3, 17), 0.0625: RGB(10, 7, 34), 0.0938: RGB(18, 13, 51), 0.125: RGB(28, 16, 70), 0.156: RGB(40, 17, 89)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])
legend_2 = Legend(Colour=gradient_2, Tags=["One Fish", "Two Fish", "Red Fish", "Blue Fish"], LegendType=1)
legend_3 = Legend(Colour=reverse(gradient_3), Tags=["One Fish", "Two Fish", "Red Fish", "Blue Fish"], LegendType=1)
data = Data()  # disabled
panel_4 = Panel("https://app.speckle.systems/projects/3e6b72252b/models/fd3c31eed0")  # disabled
list = Accounts(
    {"No account selected": , "Account (casasvil@protonmail.com | https://app.speckle.systems)": "https://app.speckle.systems/?id=f23dc31973"}, selected="Account (casasvil@protonmail.com | https://app.speckle.systems)",
    FirstSelectedItem="https://app.speckle.systems/?id=f23dc31973")  # disabled
panel_5 = Panel("https://app.speckle.systems/projects/3e6b72252b/models/c9f36d5d67")  # disabled
swatch_2 = ColourSwatch(SwatchColor=RGB(255, 255, 255))  # disabled
mcol = MeshColours(Colours=swatch_2)  # disabled
panel_6 = Panel("https://app.speckle.systems/projects/3e6b72252b/models/de5227d2c2")  # disabled
number_slider = Slider(2, range=0..2)  # disabled
number_slider_2 = Slider(1, range=0..1)  # disabled
sget = StreamGet(StreamIDURL=panel_4, SpeckleAccount=list)  # disabled
sget_2 = StreamGet(StreamIDURL=panel_5, SpeckleAccount=list)  # disabled
item = ListItem(List=reverse(gradient), Index=0, Wrap=True)  # disabled
sget_3 = StreamGet(StreamIDURL=panel_6, SpeckleAccount=list)  # disabled
number_slider_3 = Slider(10, range=0..10)

# ----
# 2. Simulation Domain
number_slider_4 = Slider(50, range=0..1000)  # disabled
number_slider_5 = Slider(300, range=0..1000)  # disabled
number_slider_6 = Slider(80, range=0..1000)  # disabled
panel_7 = Panel("10")  # disabled

series = Series(Start=0, Step=3, Count=100)
panel_8 = Panel("""5
80
500
200
1
600
500""")
number_slider_7 = Slider(0, range=0..10)
number_slider_8 = Slider(3, range=0..10)
number_slider_9 = Slider(0, range=0..100)
number_slider_10 = Slider(80, range=0..100)
number_slider_11 = Slider(1000, range=0..1000)  # disabled
number_slider_12 = Slider(2000, range=0..10000)  # disabled
number_slider_13 = Slider(649, range=500..10000)  # disabled
flatten = FlattenTree(Path="{0}")  # disabled

path_2 = FilePath("F:\Recursos\GIS\Logroño\logroño_bp_wsg84.shp")
importshp = ImportShapefileFeatures(ShapefilePath=path_2, Reproject=True)  # -> Points, Metadata, UTMZone, TranslationVector
demeta = DeconstructMetadata(Metadata=importshp.Metadata)  # -> Keys, Values
pline = PolyLine(Vertices=importshp.Points, Closed=True)
rectangle = Rectangle(Plane=PlaneXY(0, 0, 0), XSize=Domain(-1, 1), YSize=Domain(-2, 2), Radius=0)  # -> Rectangle, Length
flip = FlipCurve(Curve=pline, Guide=rectangle.Rectangle)  # -> Curve, Flag
item_2 = ListItem(List=demeta.Values, Index=9, Wrap=True)  # -> simplify(Item)
branch = BranchByIndex(Tree=demeta.Keys, Branch=0)
panel_9 = Panel(branch)

item_3 = ListItem(List=demeta.Keys, Index=0, Wrap=True)

boundary = BoundarySurfaces(Edges=flip.Curve)  # -> simplify(Surfaces)
area = Area(Geometry=boundary)  # -> Area, Centroid
smaller = SmallerThan(FirstNumber=area.Area, SecondNumber=600)  # -> SmallerThan, OrEqualTo
smaller_2 = SmallerThan(FirstNumber=item_2, SecondNumber=1)  # -> SmallerThan, OrEqualTo
and = GateAnd(A=smaller_2.OrEqualTo, B=invert(smaller.OrEqualTo))
cull_multiple = CullMultiple(L0=boundary, L1=item_2, P=invert(and))  # -> L0, L1
clean = CleanParallelR6(PrimaryData=cull_multiple.L0, SecondaryData1=cull_multiple.L1, removeEmpty=True)  # -> PrimaryData, SecondaryData1

area_2 = Area(Geometry=clean.PrimaryData)  # -> Area, Centroid
smaller_3 = SmallerThan(FirstNumber=area_2.Area, SecondNumber=1)  # -> SmallerThan, OrEqualTo
panel_10 = Panel(panel_9)

multiplication = Multiplication(A=clean.SecondaryData1, B=3)
equals = Equality(FirstNumber=multiplication, SecondNumber=0)  # -> Equality, Inequality

cull_multiple_2 = CullMultiple(L0=clean.PrimaryData, L1=multiplication, L2=equals.Equality, P=invert(smaller_3.OrEqualTo))  # -> L0, L1, L2

cull_multiple_3 = CullMultiple(L0=cull_multiple_2.L0, L1=cull_multiple_2.L1, P=invert(cull_multiple_2.L2))  # -> L0, L1
Z = UnitZ(Factor=cull_multiple_3.L1)
move = Move(Geometry=cull_multiple_3.L0, Motion=Z)  # -> Geometry, Transform
extr = Extrude(Base=cull_multiple_3.L0, Direction=Z)

number_slider_14 = Slider(0, range=0..10)
tstat = TreeStatistics(Tree=extr)  # -> Paths, Length, Count
partition = PartitionList(List=tstat.Paths, Size=Slider(10000, range=0..15000))
match = MatchTree(Tree=demeta.Values, Guide=flip.Curve)
number_slider_15 = Slider(3, range=0..10)
branch_2 = BranchByIndex(Tree=partition, Branch=number_slider_14)
branch_3 = TreeBranch(Tree=match, Path=simplify(branch_2), MaintainPaths=True)
branch_4 = TreeBranch(Tree=extr, Path=branch_2, MaintainPaths=True)
custom_mesh_settings = SettingsCustom(
    StitchSeams=False,
    SimplePlanes=False,
    Refine=False,
    MinCount=0,
    MaxCount=1000,
    AspectRatio=1,
    MaxDistance=0,
    MaxAngle=20,
    MinEdge=number_slider_15,
    MaxEdge=number_slider_15)
mesh = MeshBrep(Brep=extr, Settings=custom_mesh_settings)
mesh_2 = MeshBrep(Brep=branch_4, Settings=custom_mesh_settings)
clean_2 = CleanTree(RemoveNulls=True, RemoveInvalid=True, RemoveEmpty=True, Tree=mesh)
clean_3 = CleanTree(RemoveNulls=True, RemoveInvalid=True, RemoveEmpty=True, Tree=mesh_2)
mjoin = MeshJoin(Meshes=flatten(clean_2))

branch_5 = TreeBranch(Tree=move.Geometry, Path=branch_2, MaintainPaths=True)
branch_6 = TreeBranch(Tree=flip.Curve, Path=branch_2, MaintainPaths=True)
crv = Curve([branch_6, branch_5])
dash = DashPattern(Curve=crv, Pattern=Slider(0.7, range=0..10))  # -> Dashes, Gaps
data_2 = Data(dash.Dashes)
preview = CustomPreview(
    Geometry=data_2,
    Material={diffuse=RGB(186, 186, 186), emission=RGB(56, 56, 56), shine=0.5, specular=RGB(255, 255, 255), transparency=0})

tstat_2 = TreeStatistics(Tree=clean_3)  # -> Paths, Length, Count
branch_7 = TreeBranch(Tree=branch_3, Path=tstat_2.Paths, MaintainPaths=True)
renumber = RenumberPaths(Data=branch_7)

m_facedir = FaceNormalDirection(M=flatten(clean_3), X=False)  # -> out, G, A, P; inputs V: Vector3d
# ---------- m_facedir: VB ----------
    Component.Params.Input(0).Name = "Mesh"
    Component.Params.Input(0).Description = "Open or closed mesh"
    Component.Params.Input(1).Name = "Vector (Optional)"
    Component.Params.Input(1).Description = "Vector which defines the up direction to be tested against"
    Component.Params.Input(2).Name = "Angle Domain"
    Component.Params.Input(2).Description = "The domain that describes the range of angles to be tested against"
    Component.Params.Input(3).Name = "Absolute "
    Component.Params.Input(3).Description = "If true the returned angles are made absolute"

    Component.Params.Output(1).Name = "Preview Mesh"
    Component.Params.Output(1).Description = "A greyscale preview mesh reflecting the range of values"
    Component.Params.Output(2).Name = "Angle"
    Component.Params.Output(2).Description = "The face normal angle relative to the input vector"
    Component.Params.Output(3).Name = "Pattern"
    Component.Params.Output(3).Description = "If the R input is used, the status of each sample point relative to the provided range (0 = Below, 1 = Within, 2 = Above)"

    If M IsNot Nothing Then
      If v = Nothing Then v = New vector3d(0, 0, 1)
      Dim i,j,k,s As Integer

      Dim mf As Rhino.Geometry.Collections.MeshFaceList = Nothing
      Dim mfn As Rhino.Geometry.Collections.MeshFaceNormalList = Nothing
      Dim mv As Rhino.Geometry.Collections.MeshVertexList = Nothing
      Dim mtv As Rhino.Geometry.Collections.MeshTopologyVertexList = Nothing
      Dim mte As Rhino.Geometry.Collections.MeshTopologyEdgeList = Nothing
      Dim mn As Rhino.Geometry.Collections.MeshVertexNormalList = Nothing
      Dim mc As Rhino.Geometry.Collections.MeshVertexColorList = Nothing

      If M.facenormals.count() = 0 Then M.FaceNormals.ComputeFaceNormals()

      mf = m.Faces
      mfn = m.facenormals
      mv = m.Vertices
      mtv = m.TopologyVertices
      mte = m.TopologyEdges
      mn = m.Normals
      mc = m.VertexColors

      Dim arrAng As New list(Of Double)
      Dim mvo As New list(Of Point3d)
      Dim mfo As New list(Of meshface)
      Dim oc As New list(Of color)
      Dim tv As Integer
      Dim aMin, aMax As Double
      Dim arrPat As New list(Of Integer)

      For i = 0 To mfn.count() - 1 Step 1
        Dim ang As New Double
        s = mvo.count()
        ang = vector3d.VectorAngle(V, mfn.item(i))

        If X Then If ang > (math.PI / 2) Then ang = math.Abs(math.PI - ang)

        If i = 0 Then aMin = ang Else If ang < aMin Then aMin = ang
        If ang > aMax Then aMax = ang

        If mf.item(i).isquad() Then
          mvo.add(mv.item(mf.item(i).A))
          mvo.add(mv.item(mf.item(i).B))
          mvo.add(mv.item(mf.item(i).C))
          mvo.add(mv.item(mf.item(i).D))
          mfo.add(New meshface(s, s + 1, s + 2, s + 3))
        Else
          mvo.add(mv.item(mf.item(i).A))
          mvo.add(mv.item(mf.item(i).B))
          mvo.add(mv.item(mf.item(i).C))
          mfo.add(New meshface(s, s + 1, s + 2))
        End If

        arrAng.add(ang)
      Next

      If R = Nothing Then
        R.t0 = amin
        R.t1 = amax
      End If

      For i = 0 To mfn.count() - 1 Step 1
        If mf.item(i).isquad() Then k = 3 Else k = 2

        If arrAng.item(i) < R.T0 Then
          For j = 0 To k Step 1
            oc.add(color.FromArgb(0, 0, 255))
          Next
          arrPat.add(0)
        ElseIf ((arrAng.item(i) > R.T1) Or ((R.t0 = 0) And (R.t1 = 0))) Then
          For j = 0 To k Step 1
            oc.add(color.FromArgb(255, 0, 0))
          Next
          arrPat.add(2)
        Else
          For j = 0 To k Step 1
            tv = math.Floor((arrAng.item(i) - R.T0) / (R.t1 - R.t0) * 255)
            oc.add(color.FromArgb(tv, tv, tv))
          Next
          arrPat.add(1)
        End If
      Next
      Dim mo As New mesh
      mo.vertices.AddVertices(mvo.toarray())
      mo.Faces.AddFaces(mfo.toarray())
      mo.VertexColors.AppendColors(oc.toarray())

      G = mo
      A = arrAng
      P = arrPat

    End If
# ---------- end m_facedir ----------
demesh = DeconstructMesh(Mesh=m_facedir.G)  # -> Vertices, Faces, Colours, Normals
facen = FaceNormals(Mesh=m_facedir.G)  # -> Centers, Normals
Z_2 = UnitZ(Factor=1)
abs = Absolute(Value=facen.Normals)
tmatch = MatchText(Text=abs, Pattern=Z_2, Case=True)
cull = CullPattern(List=demesh.Faces, CullPattern=invert(tmatch))
conmesh = ConstructMesh(Vertices=demesh.Vertices, Faces=cull, Colours=demesh.Colours)
flatten_2 = FlattenTree(Tree=simplify(conmesh), Path="{0}")
flatten_3 = FlattenTree(Tree=conmesh, Path="{0}")
cullvertices = MeshCullUnusedVertices(Mesh=flatten_3)
clean_4 = CleanTree(RemoveNulls=True, RemoveInvalid=True, RemoveEmpty=True, Tree=cullvertices)

number_slider_16 = Slider(1, range=0..1)
number_slider_17 = Slider(6, range=0..10)
colrange = LBColorRange(index=Slider(2, range=0..100))  # -> colors; plug-in component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
legendpar_2 = LBLegendParameters(colors=gradient_2)  # -> leg_par; plug-in component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
run = BooleanToggle(True)
parallel = BooleanToggle(True)
incidentradiation = LBIncidentRadiation(
    sky_mtx=skymatrix.sky_mtx,
    context=flatten(clean_4),
    grid_size=number_slider_17,
    offset_dist=number_slider_16,
    legend_par=legendpar_2,
    parallel=parallel,
    run=run)  # -> report, points, results, total, mesh, legend, title, int_mtx; disabled; plug-in component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
incidentradiation_2 = LBIncidentRadiation(
    sky_mtx=skymatrix.sky_mtx,
    geometry=clean_4,
    context=mjoin,
    grid_size=number_slider_17,
    offset_dist=number_slider_16,
    legend_par=legendpar_2,
    parallel=parallel,
    run=run)  # -> report, points, results, total, mesh, legend, title, int_mtx; plug-in component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
incidentradiation_3 = LBIncidentRadiation(
    sky_mtx=skymatrix_2.sky_mtx,
    geometry=clean_4,
    context=mjoin,
    grid_size=number_slider_17,
    offset_dist=number_slider_16,
    legend_par=legendpar_2,
    parallel=parallel,
    run=run)  # -> report, points, results, total, mesh, legend, title, int_mtx; disabled; plug-in component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

colrange_2 = LBColorRange(index=Slider(4, range=0..25))  # -> colors; plug-in component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
legend_4 = Legend(Colour=colrange_2, Tags=["One Fish", "Two Fish", "Red Fish", "Blue Fish"], LegendType=1)
legendpar_3 = LBLegendParameters(colors=reverse(gradient_3))  # -> leg_par; plug-in component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
viewpercent = LBViewPercent(
    view_type=Slider(0, range=0..4),
    geometry=flatten(clean_4),
    context=flatten(mjoin),
    grid_size=number_slider_17,
    offset_dist=number_slider_16,
    geo_block=True,
    legend_par=legendpar_3,
    run=run)  # -> report, points, view_vecs, results, mesh, legend, title, int_mtx; plug-in component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

number_slider_18 = Slider(15, range=0..100)  # disabled
number_slider_19 = Slider(100, range=0..100)  # disabled
colrange_3 = LBColorRange(index=number_slider_18)  # -> colors; disabled; plug-in component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
legendpar_4 = LBLegendParameters(max=number_slider_19, colors=colrange_3)  # -> leg_par; disabled; plug-in component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
visibilitypercent = LBVisibilityPercent(
    geometry=flatten(clean_4),
    context=flatten(mjoin),
    grid_size=number_slider_17,
    offset_dist=number_slider_16,
    max_dist=Slider(150, range=0..1000),
    geo_block=parallel,
    legend_par=legendpar_4,
    parallel=parallel,
    run=run)  # -> report, points, results, mesh, legend, title, int_mtx; disabled; plug-in component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

analysisperiod_3 = LBAnalysisPeriod(start_month=7, start_day=22, start_hour=0, end_month=7, end_day=22)  # -> period, hoys, dates; plug-in component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
analysisperiod_4 = LBAnalysisPeriod(start_month=12, start_day=22, start_hour=0, end_month=12, end_day=22)  # -> period, hoys, dates; plug-in component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
entwine = Entwine(Branch00=analysisperiod_3.hoys, Branch01=analysisperiod_4.hoys, FlattenInputs=True)
sunpath = LBSunPath(location=importepw.location, hoys=entwine, scale=50)  # -> report, vectors, altitudes, azimuths, hoys, sun_pts, analemma, daily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; plug-in component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
directsunhours = LBDirectSunHours(
    vectors=sunpath.vectors,
    geometry=flatten(clean_4),
    context=flatten(mjoin),
    grid_size=number_slider_17,
    offset_dist=number_slider_16,
    legend_par=legendpar,
    run=run)  # -> report, points, results, mesh, legend, title, int_mtx; plug-in component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

vdisex = VectorDisplayEx(Point=facen.Centers, Vector=facen.Normals, Colour=RGB(0, 0, 0), Width=2)  # disabled
cull_multiple_4 = CullMultiple(L0=demesh.Faces, L1=facen.Centers, P=tmatch)  # -> L0, L1
pdecon = Deconstruct(Point=cull_multiple_4.L1)  # -> XComponent, YComponent, ZComponent
equals_2 = Equality(FirstNumber=pdecon.ZComponent, SecondNumber=0)  # -> Equality, Inequality
cull_2 = CullPattern(List=cull_multiple_4.L0, CullPattern=equals_2.Inequality)
conmesh_2 = ConstructMesh(Vertices=demesh.Vertices, Faces=cull_2)
flatten_4 = FlattenTree(Tree=conmesh_2, Path="{0}")
cullvertices_2 = MeshCullUnusedVertices(Mesh=flatten_4)
clean_5 = CleanTree(RemoveNulls=True, RemoveInvalid=True, RemoveEmpty=True, Tree=cullvertices_2)

faceb = FaceBoundaries(Mesh=flatten_3)
bang = ExplodeTree(Data=directsunhours.results)  # -> _0000, _0100

demesh_2 = DeconstructMesh(Mesh=clean_4)  # -> Vertices, Faces, Colours, Normals
demesh_3 = DeconstructMesh(Mesh=incidentradiation_2.mesh)  # -> Vertices, Faces, Colours, Normals
unflatten = UnflattenTree(Tree=demesh_3.Vertices, Guide=demesh_2.Vertices)
unflatten_2 = UnflattenTree(Tree=demesh_3.Colours, Guide=demesh_2.Colours)
conmesh_3 = ConstructMesh(Vertices=unflatten, Faces=demesh_2.Faces, Colours=unflatten_2)  # -> simplify(Mesh)
number_slider_20 = Slider(0, range=0..100)
demesh_4 = DeconstructMesh(Mesh=conmesh_3)  # -> Vertices, Faces, Colours, Normals
tstat_3 = TreeStatistics(Tree=demesh_4.Faces)  # -> Paths, Length, Count
ins = InsertItems(List=tstat_3.Length, Item=number_slider_20, Indices=number_slider_20, Wrap=False)
consec = ConsecutiveDomains(Numbers=ins, Additive=True)
dedomain = DeconstructDomain(Domain=consec)  # -> Start, End
subtraction = Subtraction(A=dedomain.End, B=1)
dom = ConstructDomain(DomainStart=dedomain.Start, DomainEnd=subtraction)
subset = SubList(List=incidentradiation_2.results, Domain=dom, Wrap=False)  # -> simplify(List), Index
graft = GraftTree(Tree=conmesh_3, IncludeEmptyLists=True, IncludeNullItems=True)  # -> simplify(Tree)

flatten_5 = FlattenTree(Tree=move.Geometry, Path="{0}")  # disabled

path_3 = FilePath("G:\app-sd-facades\gis\rhino_files\")  # disabled
concat = Concatenate(FragmentA=path_3, FragmentB="Logroño", FragmentC=".3dm")  # disabled
concat_2 = Concatenate(FragmentA="Logroño", FragmentB=number_slider_14, JoinSeparator="_")  # disabled
baketofile = BakeObjectsToFile(
    FilePath=concat,
    Geometry=incidentradiation_2.mesh,
    BakeName=concat_2,
    Bake=True,
    networkMode=True,
    overwriteMode="Add To File",
    preset="Moderate")  # disabled

mjoin_2 = MeshJoin(Meshes=flatten_5)  # disabled
mcol_2 = MeshColours(Mesh=mjoin_2, Colours=swatch_2)  # disabled
entwine_2 = Entwine(Branch00=mcol_2, Branch01=viewpercent.mesh, FlattenInputs=True)  # disabled
entwine_3 = Entwine(Branch00=mcol_2, Branch01=incidentradiation_2.mesh, FlattenInputs=True)  # disabled
bang_2 = ExplodeTree(Data=incidentradiation_3.mesh)  # -> Branch0, Branch1, Branch2; disabled
branch_8 = BranchByIndex(Tree=incidentradiation_3.mesh, Branch=number_slider)  # disabled
# https://app.speckle.systems/projects/3e6b72252b/models/92345c881e
branch_9 = BranchByIndex(Tree=sunpath.sun_pts, Branch=number_slider_2)  # disabled
branch_10 = BranchByIndex(Tree=directsunhours.mesh, Branch=number_slider_2)  # disabled
branch_11 = BranchByIndex(Tree=directsunhours.legend, Branch=number_slider_2)  # disabled
send = Send(
    Stream=sget,
    A=entwine_2,
    AutoSend=False,
    BaseId="a01b5e0021974971e777003c5bb05609",
    CurrentComponentState="up_to_date",
    KitName="Objects",
    OutputWrappers="https://app.speckle.systems\t3e6b72252b\t1d15c3ccc9",
    UseDefaultCache=True,
    selectedKitName="Objects")  # disabled
send_2 = Send(
    Stream=sget_2,
    A=entwine_3,
    AutoSend=False,
    BaseId="8bcb8ed9fb28e179fc5cfe10f04f0912",
    CurrentComponentState="up_to_date",
    KitName="Objects",
    OutputWrappers="https://app.speckle.systems\t3e6b72252b\t41f1c97f5d",
    UseDefaultCache=True,
    selectedKitName="Objects")  # disabled
mcol_3 = MeshColours(Mesh=mjoin_2, Colours=item)  # disabled
entwine_4 = Entwine(Branch00=mcol_3, Branch01=branch_10, FlattenInputs=True)  # disabled
send_3 = Send(
    Stream=sget_3,
    A=entwine_4,
    AutoSend=False,
    BaseId="e1320a9928eb7433bbd4ca037b57cb1b",
    CurrentComponentState="expired",
    KitName="Objects",
    OutputWrappers="https://app.speckle.systems\t3e6b72252b\t350dec3f3b",
    UseDefaultCache=True,
    selectedKitName="Objects")  # disabled

demesh_5 = DeconstructMesh(Mesh=graft)  # -> Vertices, Faces, Colours, Normals
facen_2 = FaceNormals(Mesh=graft)  # -> Centers, Normals
Z_3 = UnitZ(Factor=1)
abs_2 = Absolute(Value=facen_2.Normals)
tmatch_2 = MatchText(Text=abs_2, Pattern=Z_3, Case=True)
cull_3 = CullPattern(List=demesh_5.Faces, CullPattern=invert(tmatch_2))
cull_4 = CullPattern(List=subset.List, CullPattern=invert(tmatch_2))
equals_3 = Equality(FirstNumber=cull_4, SecondNumber=0)  # -> Equality, Inequality
cull_5 = CullPattern(List=cull_3, CullPattern=equals_3.Inequality)
conmesh_4 = ConstructMesh(Vertices=demesh_5.Vertices, Faces=cull_5, Colours=demesh_5.Colours)

number_slider_21 = Slider(2000, range=0..10000)  # disabled
number_slider_22 = Slider(700, range=0..1000)  # disabled
larger = LargerThan(FirstNumber=cull_4, SecondNumber=number_slider_22)  # -> LargerThan, OrEqualTo; disabled
smaller_4 = SmallerThan(FirstNumber=cull_4, SecondNumber=number_slider_21)  # -> SmallerThan, OrEqualTo; disabled
and_2 = GateAnd(A=smaller_4.OrEqualTo, B=larger.OrEqualTo)  # disabled
cull_6 = CullPattern(List=cull_3, CullPattern=and_2)  # disabled
conmesh_5 = ConstructMesh(Vertices=demesh_5.Vertices, Faces=cull_6, Colours=demesh_5.Colours)  # disabled

number_slider_23 = Slider(300, range=0..500)  # disabled
number_slider_24 = Slider(1, range=0..100)  # disabled
larger_2 = LargerThan(FirstNumber=cull_4, SecondNumber=number_slider_24)  # -> LargerThan, OrEqualTo; disabled
smaller_5 = SmallerThan(FirstNumber=cull_4, SecondNumber=number_slider_23)  # -> SmallerThan, OrEqualTo; disabled
and_3 = GateAnd(A=smaller_5.OrEqualTo, B=larger_2.OrEqualTo)  # disabled
cull_7 = CullPattern(List=cull_3, CullPattern=and_3)  # disabled
conmesh_6 = ConstructMesh(Vertices=demesh_5.Vertices, Faces=cull_7, Colours=demesh_5.Colours)  # disabled

subset_2 = SubList(List=bang._0000, Domain=dom, Wrap=False)  # -> simplify(List), Index
subset_3 = SubList(List=bang._0100, Domain=dom, Wrap=False)  # -> simplify(List), Index
subset_4 = SubList(List=viewpercent.results, Domain=dom, Wrap=False)  # -> simplify(List), Index
cull_multiple_5 = CullMultiple(L0=subset_2.List, L1=subset_3.List, L2=subset_4.List, P=equals_3.Inequality)  # -> L0, L1, L2
cull_8 = CullPattern(List=subset.List, CullPattern=equals_3.Inequality)

clean_6 = CleanTree(RemoveNulls=True, RemoveInvalid=True, RemoveEmpty=True, Tree=cull_5)  # -> simplify(Tree)
tstat_4 = TreeStatistics(Tree=clean_6)  # -> Paths, Length, Count
branch_12 = TreeBranch(Tree=simplify(demesh_5.Vertices), Path=tstat_4.Paths, MaintainPaths=True)
branch_13 = TreeBranch(Tree=simplify(cull_5), Path=tstat_4.Paths, MaintainPaths=True)
branch_14 = TreeBranch(Tree=simplify(demesh_5.Colours), Path=tstat_4.Paths, MaintainPaths=True)
conmesh_7 = ConstructMesh(Vertices=branch_12, Faces=branch_13, Colours=branch_14)
tstat_5 = TreeStatistics(Tree=simplify(clean_6))  # -> Paths, Length, Count
branch_15 = TreeBranch(Tree=simplify(graft(flatten_2)), Path=tstat_5.Paths, MaintainPaths=True)
branch_16 = TreeBranch(Tree=simplify(graft(clean_5)), Path=tstat_5.Paths, MaintainPaths=True)
branch_17 = TreeBranch(Tree=simplify(renumber), Path=tstat_5.Paths, MaintainPaths=True)
branch_18 = TreeBranch(Tree=simplify(cull_8), Path=tstat_5.Paths, MaintainPaths=True)
renumber_2 = RenumberPaths(Data=branch_17)
renumber_3 = RenumberPaths(Data=conmesh_7)
renumber_4 = RenumberPaths(Data=branch_18)
renumber_5 = RenumberPaths(Data=branch_15)
renumber_6 = RenumberPaths(Data=branch_16)
cullvertices_3 = MeshCullUnusedVertices(Mesh=renumber_3)

tbi = TreeBranchIndex(DataTree=cullvertices_3, BranchIndex=1)  # disabled
split = SplitList(List=flatten(cullvertices_3), Index=100)  # -> ListA, ListB; disabled
branch_19 = TreeBranch(Tree=simplify(cull_multiple_5.L1), Path=tstat_5.Paths, MaintainPaths=True)
branch_20 = TreeBranch(Tree=simplify(cull_multiple_5.L2), Path=tstat_5.Paths, MaintainPaths=True)
branch_21 = TreeBranch(Tree=simplify(cull_multiple_5.L0), Path=tstat_5.Paths, MaintainPaths=True)
mjoin_3 = MeshJoin(Meshes=flatten(split.ListA))  # disabled
renumber_7 = RenumberPaths(Data=branch_19)
renumber_8 = RenumberPaths(Data=branch_20)
renumber_9 = RenumberPaths(Data=branch_21)
cullvertices_4 = MeshCullUnusedVertices(Mesh=mjoin_3)  # disabled

demesh_6 = DeconstructMesh(Mesh=cullvertices_3)  # -> Vertices, Faces, Colours, Normals
amp = Amplitude(Vector=demesh_6.Normals, Amplitude=1)
move_2 = Move(Geometry=demesh_6.Vertices, Motion=amp)  # -> Geometry, Transform
fastmeshray = FastMeshRayIntersect(Meshes=mjoin, RayStart=move_2.Geometry, RayDirection=demesh_6.Normals, accurateMeshRay=True, computeBBMeshRay=True)  # -> Hit, CollisionIndex, RayParameter
gradient_4 = Gradient(
    LowerLimit=1,
    UpperLimit=0,
    Parameter=fastmeshray.Hit,
    stops=[0: RGB(255, 255, 216), 0.0312: RGB(250, 253, 206), 0.0625: RGB(245, 251, 196), 0.0938: RGB(241, 249, 186), 0.125: RGB(236, 247, 177), 0.156: RGB(227, 244, 177)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])
conmesh_8 = ConstructMesh(Vertices=demesh_6.Vertices, Faces=demesh_6.Faces, Colours=gradient_4)
mblur = BlurMesh(Mesh=conmesh_8, Iterations=1)

number_slider_25 = Slider(120, range=0..1000)
replace = ReplaceMembers(Set=fastmeshray.RayParameter, Find=Slider(-1, range=-1..0), Replace=Slider(100000, range=0..100000))
gradient_5 = Gradient(
    LowerLimit=number_slider_8,
    UpperLimit=number_slider_25,
    Parameter=replace,
    stops=[0: RGB(255, 255, 216), 0.0312: RGB(250, 253, 206), 0.0625: RGB(245, 251, 196), 0.0938: RGB(241, 249, 186), 0.125: RGB(236, 247, 177), 0.156: RGB(227, 244, 177)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])
conmesh_9 = ConstructMesh(Vertices=demesh_6.Vertices, Faces=demesh_6.Faces, Colours=gradient_5)
mblur_2 = BlurMesh(Mesh=conmesh_9, Iterations=1)

deface = DeconstructFace(Face=demesh_6.Faces)  # -> CornerA, CornerB, CornerC, CornerD
merge_2 = Merge(Data1=graft(deface.CornerC), Data2=graft(deface.CornerD))
cset = CreateSet(List=merge_2)  # -> Set, Map
merge_3 = Merge(Data1=graft(deface.CornerA), Data2=graft(deface.CornerB), Data3=cset.Set)
tstat_6 = TreeStatistics(Tree=merge_3)  # -> Paths, Length, Count
dup = DuplicateData(Data=graft(renumber_4), Number=graft(tstat_6.Length), Order=True)  # -> flatten(Data)

dup_2 = DuplicateData(Data=graft(renumber_9), Number=graft(tstat_6.Length), Order=True)  # -> flatten(Data)
dup_3 = DuplicateData(Data=graft(renumber_8), Number=graft(tstat_6.Length), Order=True)  # -> flatten(Data)
dup_4 = DuplicateData(Data=graft(renumber_7), Number=graft(tstat_6.Length), Order=True)  # -> flatten(Data)
unflatten_3 = UnflattenTree(Tree=dup_2, Guide=demesh_6.Vertices)  # -> simplify(Tree)
unflatten_4 = UnflattenTree(Tree=dup_4, Guide=demesh_6.Vertices)  # -> simplify(Tree)
unflatten_5 = UnflattenTree(Tree=dup_3, Guide=demesh_6.Vertices)  # -> simplify(Tree)

pdecon_2 = Deconstruct(Point=demesh_6.Vertices)  # -> XComponent, YComponent, ZComponent
bnd = Bounds(Numbers=flatten(pdecon_2.ZComponent))
dedomain_2 = DeconstructDomain(Domain=bnd)  # -> Start, End
gradient_6 = Gradient(
    LowerLimit=dedomain_2.Start,
    UpperLimit=dedomain_2.End,
    Parameter=pdecon_2.ZComponent,
    stops=[0: RGB(0, 34, 77), 0.0312: RGB(0, 40, 91), 0.0625: RGB(0, 45, 105), 0.0938: RGB(4, 50, 112), 0.125: RGB(26, 56, 111), 0.156: RGB(39, 61, 109)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])
conmesh_10 = ConstructMesh(Vertices=demesh_6.Vertices, Faces=demesh_6.Faces, Colours=gradient_6)
mblur_3 = BlurMesh(Mesh=conmesh_10, Iterations=1)

roundn = RoundToNearest(NumbersX=pdecon_2.ZComponent, NumbersY=series, RemapX=False)  # -> simplify(Nearest), Index, Difference, RemappedX
dom_2 = ConstructDomain(DomainStart=number_slider_8, DomainEnd=number_slider_25)
remap = RemapNumbers(Value=fastmeshray.RayParameter, Source=dom_2, Target=Domain(0.2, 1))  # -> Mapped, Clipped
mblur_4 = BlurMesh(Mesh=conmesh_9, Iterations=1)
unflatten_6 = UnflattenTree(Tree=dup, Guide=demesh_6.Vertices)  # -> simplify(Tree)

vecstar = VectorStar(Plane=PlaneXY(0, 0, 0), Steps=1, SubdivisionType=0, Dimensionality=True)  # -> Vectors, Lines
shift_2 = ShiftList(List=vecstar.Lines, Shift=6, Wrap=True)
lng = ListLength(List=vecstar.Vectors)
rev = ReverseList(List=shift_2)
cvec = ClosestVector(Reference=demesh_6.Normals, Targets=vecstar.Vectors, KeepLength=False)  # -> Closest, simplify(Index), Angle
midpt = CurveMiddle(Curve=rev)
gradient_7 = Gradient(
    LowerLimit=0,
    UpperLimit=lng,
    Parameter=cvec.Index,
    stops=[0: RGB(141, 0, 82), 0.0312: RGB(159, 9, 95), 0.0625: RGB(176, 17, 108), 0.0938: RGB(193, 25, 122), 0.125: RGB(203, 50, 137), 0.156: RGB(211, 79, 152)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])
points = PointList(Points=midpt)
conmesh_11 = ConstructMesh(Vertices=demesh_6.Vertices, Faces=demesh_6.Faces, Colours=gradient_7)

pdecon_3 = Deconstruct(Point=demesh_6.Vertices)  # -> XComponent, YComponent, ZComponent
series_2 = Series(Start=1.5, Step=3, Count=100)
roundn_2 = RoundToNearest(NumbersX=pdecon_3.ZComponent, NumbersY=series_2, RemapX=False)  # -> Nearest, Index, Difference, RemappedX
pt = ConstructPoint(XCoordinate=pdecon_3.XComponent, YCoordinate=pdecon_3.YComponent, ZCoordinate=roundn_2.Nearest)

# ---- group: filter by height
tstat_7 = TreeStatistics(Tree=simplify(graft(roundn.Nearest)))  # -> Paths, Length, Count
cset_2 = CreateSet(List=roundn.Nearest)  # -> Set, Map
mindex = MemberIndex(Set=roundn.Nearest, Member=cset_2.Set)  # -> Index, Count
shiftm_r6 = ShiftMatchR6(Data=mindex.Index, Guide=roundn.Nearest)
item_4 = ListItem(List=tstat_7.Paths, Index=shiftm_r6, Wrap=True)
unflatten_7 = UnflattenTree(Tree=item_4, Guide=mindex.Index)

# ---- group: filter by orientation
branch_22 = TreeBranch(Tree=graft(cvec.Index), Path=flatten(unflatten_7), MaintainPaths=True)
unflatten_8 = UnflattenTree(Tree=branch_22, Guide=unflatten_7)
cset_3 = CreateSet(List=unflatten_8)  # -> Set, Map
mindex_2 = MemberIndex(Set=unflatten_8, Member=cset_3.Set)  # -> Index, Count
shiftm_r6_2 = ShiftMatchR6(Data=mindex_2.Index, Guide=unflatten_8)
item_5 = ListItem(List=unflatten_7, Index=shiftm_r6_2, Wrap=True)
unflatten_9 = UnflattenTree(Tree=item_5, Guide=mindex_2.Index)

# ----
number_slider_26 = Slider(29, range=0..100)
tbi_2 = TreeBranchIndex(DataTree=cullvertices_3, BranchIndex=number_slider_26)
tbi_3 = TreeBranchIndex(DataTree=renumber_2, BranchIndex=number_slider_26)
panel_11 = Panel("""area_fachada
area_cubierta""")
concat_3 = Concatenate(FragmentA=graft(panel_9), FragmentB=graft(tbi_3), JoinSeparator=": ")  # -> flatten(Result)
demesh_7 = DeconstructMesh(Mesh=tbi_2)  # -> Vertices, Faces, Colours, Normals
area_3 = Area(Geometry=tbi_2)  # -> Area, Centroid
area_4 = Area(Geometry=renumber_5)  # -> Area, Centroid
avr = Average(Input=demesh_7.Vertices)  # disabled
round = Round(Number=area_3.Area)  # -> Nearest, Floor, Ceiling; disabled
round_2 = Round(Number=area_4.Area)  # -> Nearest, Floor, Ceiling
merge_4 = Merge(Data1=round.Nearest, Data2=round_2.Nearest)  # disabled
concat_4 = Concatenate(FragmentA=graft(panel_11), FragmentB=graft(merge_4), JoinSeparator=": ")  # -> flatten(Result); disabled
panel_12 = Panel("")  # disabled
join = TextJoin(Text=concat_3, Join=panel_12)  # disabled
join_2 = TextJoin(Text=concat_4, Join=panel_12)  # disabled
merge_5 = Merge(Data1=join, Data2=join_2)  # -> flatten(Result); disabled
join_3 = TextJoin(Text=merge_5, Join=panel_12)  # disabled
textdot = DefineTextDot(Text=join_3, Location=avr, Font="Arial", Size=11)  # disabled
zoom = ZoomTo(TargetPoint=avr, Reset=True, Distance=200)  # disabled

area_5 = Area(Geometry=renumber_6)  # -> Area, Centroid
round_3 = Round(Number=area_5.Area)  # -> Nearest, Floor, Ceiling

cps = ClosestPoints(Point=area_4.Centroid, Cloud=flatten(area_4.Centroid), Count=10)  # -> ClosestPoint, CPIndex, Distance
data_3 = Data(renumber_5)
ma = MassAddition(Input=cps.Distance)  # -> Result, PartialResults
gradient_8 = Gradient(
    LowerLimit=0,
    UpperLimit=500,
    Parameter=ma.Result,
    stops=[0: RGB(0, 0, 0), 0.0312: RGB(6, 6, 9), 0.0625: RGB(13, 13, 19), 0.0938: RGB(20, 20, 29), 0.125: RGB(27, 27, 38), 0.156: RGB(34, 34, 48)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])
mcol_4 = MeshColours(Mesh=data_3, Colours=gradient_8)

flatten_6 = FlattenTree(Tree=unflatten_6, Path="{0}")
flatten_7 = FlattenTree(Tree=unflatten_3, Path="{0}")
flatten_8 = FlattenTree(Tree=unflatten_4, Path="{0}")
flatten_9 = FlattenTree(Tree=unflatten_5, Path="{0}")
flatten_10 = FlattenTree(Tree=cvec.Index, Path="{0}")
flatten_11 = FlattenTree(Tree=pdecon_2.ZComponent, Path="{0}")
flatten_12 = FlattenTree(Tree=fastmeshray.Hit, Path="{0}")
flatten_13 = FlattenTree(Tree=replace, Path="{0}")
renumber_10 = RenumberPaths(Data=ma.Result)
unflatten_10 = UnflattenTree(Tree=flatten_6, Guide=unflatten_9)
unflatten_11 = UnflattenTree(Tree=flatten_7, Guide=unflatten_9)
unflatten_12 = UnflattenTree(Tree=flatten_8, Guide=unflatten_9)
unflatten_13 = UnflattenTree(Tree=flatten_9, Guide=unflatten_9)
unflatten_14 = UnflattenTree(Tree=flatten_10, Guide=unflatten_9)
unflatten_15 = UnflattenTree(Tree=flatten_11, Guide=unflatten_9)
unflatten_16 = UnflattenTree(Tree=flatten_12, Guide=unflatten_9)
unflatten_17 = UnflattenTree(Tree=flatten_13, Guide=unflatten_9)
dup_5 = DuplicateData(Data=graft(renumber_10), Number=graft(tstat_6.Length), Order=True)  # -> flatten(Data)
shift_3 = ShiftPaths(Data=unflatten_10, Offset=-2)
unflatten_18 = UnflattenTree(Tree=dup_5, Guide=demesh_6.Vertices)  # -> simplify(Tree)
flatten_14 = FlattenTree(Tree=unflatten_18, Path="{0}")
unflatten_19 = UnflattenTree(Tree=flatten_14, Guide=unflatten_9)
item_6 = ListItem(List=unflatten_15, Index=0, Wrap=True)
item_7 = ListItem(List=unflatten_14, Index=0, Wrap=True)
shift_4 = ShiftPaths(Data=item_7, Offset=-2)
shift_5 = ShiftPaths(Data=item_6, Offset=-2)
avr_2 = Average(Input=unflatten_19)
avr_3 = Average(Input=unflatten_13)
avr_4 = Average(Input=unflatten_12)
avr_5 = Average(Input=unflatten_11)
avr_6 = Average(Input=unflatten_17)
avr_7 = Average(Input=unflatten_10)
avr_8 = Average(Input=unflatten_16)
shift_6 = ShiftPaths(Data=avr_2, Offset=-2)
shift_7 = ShiftPaths(Data=avr_4, Offset=-2)
shift_8 = ShiftPaths(Data=avr_8, Offset=-2)
shift_9 = ShiftPaths(Data=avr_6, Offset=-2)
shift_10 = ShiftPaths(Data=avr_7, Offset=-2)
shift_11 = ShiftPaths(Data=avr_5, Offset=-2)
shift_12 = ShiftPaths(Data=avr_3, Offset=-2)
flatten_15 = FlattenTree(Tree=shift_8, Path="{0}")  # disabled
flatten_16 = FlattenTree(Tree=shift_9, Path="{0}")  # disabled
flatten_17 = FlattenTree(Tree=shift_6, Path="{0}")  # disabled
flatten_18 = FlattenTree(Tree=shift_4, Path="{0}")  # disabled
flatten_19 = FlattenTree(Tree=shift_5, Path="{0}")  # disabled
flatten_20 = FlattenTree(Tree=shift_10, Path="{0}")  # disabled
flatten_21 = FlattenTree(Tree=shift_11, Path="{0}")  # disabled
flatten_22 = FlattenTree(Tree=shift_7, Path="{0}")  # disabled
flatten_23 = FlattenTree(Tree=shift_12, Path="{0}")  # disabled

item_8 = ListItem(List=renumber_2, Index=3, Wrap=True)
duplicate = DuplicateDataMatchR6(SourceDataTree=item_8, SecondaryData1="Logroño", SecondaryData2=number_slider_14)  # -> SourceData, SecondaryData1, SecondaryData2, SecondaryData3
tstat_8 = TreeStatistics(Tree=duplicate.SecondaryData1)  # -> Paths, Length, Count
hops = Hops(
    City=duplicate.SecondaryData1,
    Local_id=duplicate.SourceData,
    Facade_area=round_2.Nearest,
    Roof_area=round_3.Nearest,
    Batch_id=duplicate.SecondaryData2,
    CacheResultsInMemory=True,
    CacheSolveResults=True,
    RemoteDefinitionLocation="http://127.0.0.1:5000/send_general_building_data",
    RemoteSolveVersion=(0, 1, 0),
    ShowInput_Enabled=True,
    ShowInput_Path=False,
    SynchronousSolve=True)  # disabled

duplicate_2 = DuplicateDataMatchR6(SourceDataTree=shift_3, SecondaryData2=duplicate.SourceData, SecondaryData1=duplicate.SecondaryData2)  # -> SourceData, SecondaryData2, SecondaryData1
unflatten_20 = UnflattenTree(Tree=duplicate_2.SecondaryData2, Guide=unflatten_10)
unflatten_21 = UnflattenTree(Tree=duplicate_2.SecondaryData1, Guide=unflatten_10)
item_9 = ListItem(List=unflatten_20, Index=0, Wrap=True)
item_10 = ListItem(List=unflatten_21, Index=0, Wrap=True)
shift_13 = ShiftPaths(Data=item_10, Offset=-2)
shift_14 = ShiftPaths(Data=item_9, Offset=-2)
tstat_9 = TreeStatistics(Tree=shift_14)  # -> Paths, Length, Count
flatten_24 = FlattenTree(Tree=shift_14, Path="{0}")  # disabled
dpath = DeconstructPath(Branch=tstat_9.Paths)  # -> flatten(Indices)
split_2 = SplitList(List=dpath, Index=100)  # -> ListA, ListB
panel_13 = Panel(split_2.ListB)
branch_23 = BranchByIndex(Tree=shift_14, Branch=panel_13)  # -> simplify(graft(Results))
branch_24 = BranchByIndex(Tree=shift_10, Branch=panel_13)  # -> simplify(graft(Results))
branch_25 = BranchByIndex(Tree=shift_11, Branch=panel_13)  # -> simplify(graft(Results))
branch_26 = BranchByIndex(Tree=shift_7, Branch=panel_13)  # -> simplify(graft(Results))
branch_27 = BranchByIndex(Tree=shift_12, Branch=panel_13)  # -> simplify(graft(Results))
branch_28 = BranchByIndex(Tree=shift_4, Branch=panel_13)  # -> simplify(graft(Results))
branch_29 = BranchByIndex(Tree=shift_9, Branch=panel_13)  # -> simplify(graft(Results))
branch_30 = BranchByIndex(Tree=shift_5, Branch=panel_13)  # -> simplify(graft(Results))
branch_31 = BranchByIndex(Tree=shift_8, Branch=panel_13)  # -> simplify(graft(Results))
branch_32 = BranchByIndex(Tree=shift_6, Branch=panel_13)  # -> simplify(graft(Results))
branch_33 = BranchByIndex(Tree=shift_13, Branch=panel_13)  # -> simplify(graft(Results))
panel_14 = Panel(branch_33)
panel_15 = Panel(branch_23)
panel_16 = Panel(branch_28)
branch_34 = BranchByIndex(Tree=shift_10, Branch=0)
dpath_2 = DeconstructPath(Branch=tstat_8.Paths)  # -> simplify(Indices)
panel_17 = Panel(branch_34)

pt_2 = Point(Point(5530.828404, -3249.091205, 0))
pt_3 = Point(Point(-1257.020482, 1334.198086, 0))
path_4 = FilePath("F:\Recursos\GIS\Logroño\tramo_vial_wsg84.shp")
vec2pt = Vector2Pt(PointA=pt_2, PointB=pt_3, Unitize=False)  # -> Vector, Length
importshp_2 = ImportShapefileFeatures(ShapefilePath=path_4, Reproject=False, TranslationVector=vec2pt.Vector)  # -> Points, Metadata, UTMZone, TranslationVector
pline_2 = PolyLine(Vertices=importshp_2.Points, Closed=False)
demeta_2 = DeconstructMetadata(Metadata=importshp_2.Metadata)  # -> Keys, Values
move_3 = Move(Geometry=pline_2, Motion=vec2pt.Vector)  # -> Geometry, Transform
item_11 = ListItem(List=demeta_2.Values, Index=9, Wrap=True)
flatten_25 = FlattenTree(Tree=item_11, Path="{0}")
cset_4 = CreateSet(List=flatten(flatten_25))  # -> Set, Map
mindex_3 = MemberIndex(Set=flatten(flatten_25), Member=cset_4.Set)  # -> Index, Count
unflatten_22 = UnflattenTree(Tree=flatten(move_3.Geometry), Guide=mindex_3.Index)
unflatten_23 = UnflattenTree(Tree=flatten(flatten_25), Guide=mindex_3.Index)

tbi_4 = TreeBranchIndex(DataTree=demeta_2.Keys, BranchIndex=0)
item_12 = ListItem(List=demeta_2.Values, Index=30, Wrap=True)  # -> flatten(Item)
cset_5 = CreateSet(List=flatten(item_12))  # -> Set, Map
cset_6 = CreateSet(List=item_12)  # -> Set, Map
lng_2 = ListLength(List=cset_6.Set)
mindex_4 = MemberIndex(Set=item_12, Member=cset_6.Set)  # -> Index, Count
item_13 = ListItem(List=flatten(move_3.Geometry), Index=mindex_3.Index, Wrap=True)

panel_18 = Panel(tbi_4)
divlength = DivideLength(Curve=item_13, Length=10)  # -> Points, Tangents, Parameters
flatten_26 = FlattenTree(Tree=divlength.Points, Path="{0}")
parpointcp = ParPointCP(Points=move_2.Geometry, Cloud=flatten_26, Number=1)  # -> Points, Indices

tstat_10 = TreeStatistics(Tree=simplify(mindex_4.Index))  # -> Paths, Length, Count
flatten_27 = FlattenTree(Tree=mindex_3.Index, Path="{0}")
dpath_3 = DeconstructPath(Branch=tstat_10.Paths)
gradient_9 = Gradient(
    LowerLimit=0,
    UpperLimit=lng_2,
    Parameter=dpath_3,
    stops=[0: RGB(48, 18, 59), 0.0312: RGB(57, 41, 114), 0.0625: RGB(64, 64, 161), 0.0938: RGB(68, 86, 199), 0.125: RGB(70, 107, 227), 0.156: RGB(70, 127, 246)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])
preview_2 = CustomPreview(Geometry=item_13, Material=gradient_9)
previewlw = CustomPreviewLineweights(Geometry=item_13, Shader=gradient_9, Thickness=2, Absolute=False)
shiftm_r6_3 = ShiftMatchR6(Data=divlength.Points, Guide=item_13)

vec2pt_2 = Vector2Pt(PointA=graft(move_2.Geometry), PointB=parpointcp.Points, Unitize=False)  # -> Vector, Length
dist = Distance(PointA=graft(move_2.Geometry), PointB=parpointcp.Points)
unflatten_24 = UnflattenTree(Tree=vec2pt_2.Vector, Guide=move_2.Geometry)
unflatten_25 = UnflattenTree(Tree=dist, Guide=move_2.Geometry)
fastmeshray_2 = FastMeshRayIntersect(Meshes=mjoin, RayStart=move_2.Geometry, RayDirection=unflatten_24, accurateMeshRay=True, computeBBMeshRay=True)  # -> Hit, CollisionIndex, RayParameter
unweave = Unweave(List=unflatten_25, UnweavePattern=fastmeshray_2.Hit)  # -> Data0, Data1
remap_2 = RemapNumbers(Value=unweave.Data0, Source=Domain(1, 100), Target=Domain(1, 0.6))  # -> Mapped, Clipped
multiplication_2 = Multiplication(A=unweave.Data0, B=remap_2.Mapped)
multiplication_3 = Multiplication(A=unweave.Data1, B=".15")
weave = Weave(Pattern=fastmeshray_2.Hit, Stream0=multiplication_2, Stream1=multiplication_3, NullGaps=False)

dup_6 = DuplicateDataMatchR6(SourceDataTree=shiftm_r6_3, SecondaryData1=graft(panel_8))  # -> SourceData, flatten(SecondaryData1)
rtree = CreateRTree(InputGeometry=flatten_26)
split_3 = SplitList(List=flatten(dist), Index=10)  # -> ListA, ListB
rtree_cp = RTreeClosestPoint(SearchPoints=move_2.Geometry, RTree=rtree)  # -> ClosestPoint, ClosestIndex
item_14 = ListItem(List=flatten(flatten_26), Index=parpointcp.Indices, Wrap=True)
dup_7 = DuplicateDataMatchR6(SourceDataTree=flatten(dist), SecondaryData1=Slider(80, range=0..100))  # -> SourceData, SecondaryData1
item_15 = ListItem(List=dup_6.SecondaryData1, Index=parpointcp.Indices, Wrap=True)
flatten_28 = FlattenTree(Tree=item_15, Path="{0}")

number_slider_27 = Slider(40, range=0..1000)
number_slider_28 = Slider(100000, range=0..100000)
replace_2 = ReplaceMembers(Set=weave, Find=Slider(-1, range=-1..0), Replace=number_slider_7)
gradient_10 = Gradient(
    LowerLimit=number_slider_7,
    UpperLimit=number_slider_27,
    Parameter=replace_2,
    stops=[0: RGB(0, 0, 3), 0.0312: RGB(3, 2, 18), 0.0625: RGB(10, 7, 35), 0.0938: RGB(20, 11, 54), 0.125: RGB(32, 12, 74), 0.156: RGB(46, 10, 90)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])
conmesh_12 = ConstructMesh(Vertices=demesh_6.Vertices, Faces=demesh_6.Faces, Colours=gradient_10)
mblur_5 = BlurMesh(Mesh=conmesh_12, Iterations=1)

tag = TextTag(Location=item_14, Text=item_15)
hops_2 = Hops(
    SourceNoiseLevelInDB=dup_7.SecondaryData1,
    Traffic_intensity=flatten_28,
    DistanceFromTheSource=dup_7.SourceData,
    CacheResultsInMemory=False,
    CacheSolveResults=False,
    RemoteDefinitionLocation="http://127.0.0.1:5000/calculate_noise_intensity",
    RemoteSolveVersion=(0, 1, 0),
    ShowInput_Enabled=True,
    ShowInput_Path=False,
    SynchronousSolve=True)
bnd_2 = Bounds(Numbers=hops_2)
unflatten_26 = UnflattenTree(Tree=hops_2, Guide=unflatten_25)
dedomain_3 = DeconstructDomain(Domain=bnd_2)  # -> Start, End
dom_3 = ConstructDomain(DomainStart=dedomain_3.Start, DomainEnd=number_slider_10)
multiplication_4 = Multiplication(A=unflatten_26, B=remap.Mapped)
div = DivideDomain(Domain=dom_3, Count=Slider(5, range=0..10))
gradient_11 = Gradient(
    LowerLimit=dedomain_3.Start,
    UpperLimit=number_slider_10,
    Parameter=unflatten_26,
    stops=[0: RGB(48, 18, 59), 0.0312: RGB(57, 41, 114), 0.0625: RGB(64, 64, 161), 0.0938: RGB(68, 86, 199), 0.125: RGB(70, 107, 227), 0.156: RGB(70, 127, 246)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])
fdom = FindDomain(Domains=div, Number=hops_2, Strict=False)  # -> Index, Neighbour
unflatten_27 = UnflattenTree(Tree=gradient_11, Guide=unflatten_25)
mblur_6 = BlurMesh(Mesh=conmesh_12, Iterations=1)
conmesh_13 = ConstructMesh(Vertices=demesh_6.Vertices, Faces=demesh_6.Faces, Colours=unflatten_27)
mblur_7 = BlurMesh(Mesh=conmesh_13, Iterations=1)

flatten_29 = FlattenTree(Tree=pdecon_2.ZComponent, Path="{0}")  # disabled
flatten_30 = FlattenTree(Tree=dup, Path="{0}")  # disabled
flatten_31 = FlattenTree(Tree=fastmeshray.RayParameter, Path="{0}")  # disabled
flatten_32 = FlattenTree(Tree=replace, Path="{0}")  # disabled
# GROUP BY HEIGHT AND ORIENTATION (ALSO BY THE LOCAL ID)
flatten_33 = FlattenTree(Tree=replace_2, Path="{0}")  # disabled
bnd_3 = Bounds(Numbers=flatten_29)  # disabled
bnd_4 = Bounds(Numbers=flatten_30)  # disabled
bnd_5 = Bounds(Numbers=flatten_31)  # disabled
dom_4 = ConstructDomain(DomainStart=number_slider_8, DomainEnd=number_slider_25)  # disabled
dom_5 = ConstructDomain(DomainStart=number_slider_7, DomainEnd=number_slider_27)  # disabled
remap_3 = RemapNumbers(Value=flatten_29, Source=bnd_3, Target=Domain(0, 1))  # -> Mapped, Clipped; disabled
remap_4 = RemapNumbers(Value=flatten_32, Source=dom_4, Target=Domain(1, 0))  # -> Mapped, Clipped; disabled
remap_5 = RemapNumbers(Value=flatten_30, Source=bnd_4, Target=Domain(0, 1))  # -> Mapped, Clipped; disabled
remap_6 = RemapNumbers(Value=flatten_31, Source=bnd_5, Target=Domain(1, 0))  # -> Mapped, Clipped; disabled
remap_7 = RemapNumbers(Value=flatten_33, Source=dom_5, Target=Domain(0, 1))  # -> Mapped, Clipped; disabled
entwine_5 = Entwine(
    Branch00=remap_3.Mapped,
    Branch01=remap_5.Mapped,
    Branch02=remap_6.Mapped,
    Branch03=remap_4.Mapped,
    Branch04=remap_7.Mapped,
    FlattenInputs=True)  # disabled
roundd = RoundToDecimalPlace(NumberX=entwine_5, DecimalPlace=2, RoundType=0)  # -> Rounded, Difference; disabled
number_slider_29 = Slider(4, range=0..10)  # disabled
flip_2 = FlipMatrix(Data=roundd.Rounded)  # disabled
k_means = KMeansClustering(TrainingInputs=flip_2, OfClusters=number_slider_29, RandomSeed=5)  # -> Result, Likelihood, Centroids; disabled

entwine_6 = Entwine(
    Branch00=flatten_29,
    Branch01=flatten_30,
    Branch02=flatten_31,
    Branch03=flatten_32,
    Branch04=flatten_33,
    FlattenInputs=True)  # disabled
normalize = NormalizeData(Data=entwine_6, FixZero=False, NormalizationMode=0, m_maxBins=16, m_useCDF=True)  # disabled

deface_2 = DeconstructFace(Face=demesh_6.Faces)  # -> CornerA, CornerB, CornerC, CornerD
merge_6 = Merge(Data1=graft(deface_2.CornerC), Data2=graft(deface_2.CornerD))
cset_7 = CreateSet(List=merge_6)  # -> Set, Map
merge_7 = Merge(Data1=graft(deface_2.CornerA), Data2=graft(deface_2.CornerB), Data3=cset_7.Set)
item_16 = ListItem(List=flatten(k_means.Result), Index=merge_7, Wrap=True)
cset_8 = CreateSet(List=item_16)  # -> Set, Map
mindex_5 = MemberIndex(Set=item_16, Member=cset_8.Set)  # -> Index, Count
sort = SortList(Keys=mindex_5.Count, ValuesA=cset_8.Set)  # -> Keys, ValuesA
item_17 = ListItem(List=reverse(sort.ValuesA), Index=0, Wrap=True)
equals_4 = Equality(FirstNumber=item_17, SecondNumber=Slider(0, range=0..5))  # -> Equality, Inequality
cull_9 = CullPattern(List=graft(demesh_6.Faces), CullPattern=equals_4.Equality)
shift_15 = ShiftPaths(Data=simplify(cull_9), Offset=-1)
clean_7 = CleanTree(RemoveNulls=True, RemoveInvalid=True, RemoveEmpty=True, Tree=shift_15)

entwine_7 = Entwine(
    Branch00=unflatten_6,
    Branch01=unflatten_3,
    Branch02=unflatten_4,
    Branch03=unflatten_5,
    Branch04=cvec.Index,
    Branch05=pdecon_2.ZComponent,
    Branch06=fastmeshray.Hit,
    Branch07=replace,
    Branch08=replace_2,
    Branch09=unflatten_18,
    FlattenInputs=True)  # -> simplify(Result)

unflatten_28 = UnflattenTree(Tree=k_means.Result, Guide=demesh_6.Vertices)
random = Random(Range=Domain(0, 1000), Number=3, Seed=Slider(49, range=0..100), Integers=True)  # -> simplify(graft(Random))
cset_9 = CreateSet(List=flatten(unflatten_28))  # -> Set, Map
tstat_11 = TreeStatistics(Tree=cset_9.Set)  # -> Paths, Length, Count
bang_3 = ExplodeTree(Data=random)  # -> Branch0, Branch1, Branch2
random_2 = Random(Range=Domain(0, 255), Number=tstat_11.Length, Seed=bang_3.Branch0)  # -> graft(Random)
random_3 = Random(Range=Domain(0, 255), Number=tstat_11.Length, Seed=bang_3.Branch1)  # -> graft(Random)
random_4 = Random(Range=Domain(0, 255), Number=tstat_11.Length, Seed=bang_3.Branch2)  # -> graft(Random)
rgb = ColourRGB(Alpha=255, Red=random_2, Green=random_3, Blue=random_4)  # -> flatten(Colour)
item_18 = ListItem(List=rgb, Index=unflatten_28, Wrap=True)
conmesh_14 = ConstructMesh(Vertices=demesh_6.Vertices, Faces=demesh_6.Faces, Colours=item_18)
conmesh_15 = ConstructMesh(Vertices=demesh_6.Vertices, Faces=clean_7, Colours=item_18)  # disabled

flatten_34 = FlattenTree(Tree=replace_2, Path="{0}")
unflatten_29 = UnflattenTree(Tree=flatten_34, Guide=unflatten_9)
avr_9 = Average(Input=unflatten_29)
shift_16 = ShiftPaths(Data=avr_9, Offset=-2)
flatten_35 = FlattenTree(Tree=shift_16, Path="{0}")  # disabled
branch_35 = BranchByIndex(Tree=shift_16, Branch=panel_13)  # -> simplify(graft(Results))
hops_3 = Hops(
    _Enabled=Toggle(True),
    Local_id=branch_23,
    Avg_sun_exposure=branch_24,
    Winter_exposure=branch_25,
    Summer_exposure=branch_26,
    Visibility=branch_27,
    Orientation=branch_28,
    Height=branch_30,
    Distance=branch_31,
    Distance_clamp=branch_29,
    Noise=branch_35,
    Density=branch_32,
    Batch_id=branch_33,
    CacheResultsInMemory=False,
    CacheSolveResults=False,
    RemoteDefinitionLocation="http://127.0.0.1:5000/send_simulation_results",
    RemoteSolveVersion=(0, 1, 0),
    ShowInput_Enabled=True,
    ShowInput_Path=False,
    SynchronousSolve=True)

input = DataInput(
    Destination="G:\app-sd-facades\gis\speckle_stream_account.ghdata",
    RelativePath="G:\app-sd-facades\gis\speckle_stream_account.ghdata|speckle_stream_account.ghdata",
    UpdateDelay=50000)  # disabled
send_4 = Send(
    Stream=input,
    Fachadas_cluester=flatten(conmesh_14),
    Cubiertas=clean_5,
    AutoSend=False,
    BaseId="e26176e54670c6ed6a716c40ca9a1760",
    CurrentComponentState="expired",
    KitName="Objects",
    OutputWrappers="https://speckle.xyz\tdf13255f81\t0c61f52341",
    UseDefaultCache=True,
    selectedKitName="Objects")  # disabled

# ----
# 1. Geometry &
# Boundary Conditions
number_slider_30 = Slider(13, range=0..13)  # disabled
series_3 = Series(Start=0, Step=45, Count=8)  # disabled
panel_19 = Panel("""0
45
90
135
180
225
270
315""")  # disabled
addition = Addition(A=number_slider_30, B=1)  # disabled
addition_2 = Addition(A=number_slider_30, B=10)  # disabled
panel_20 = Panel("50")  # disabled

item_19 = ListItem(List=panel_19, Index=0, Wrap=True)  # disabled

abl = ABL(WDir=item_19, Uref=panel_20, Zref=addition_2, Z0=addition, ZGround=number_slider_30)  # disabled

geo = Geometry(cullvertices_4)  # disabled
domaincyl = CylindricalDomain(Geometry=geo, BoundaryCondition=abl, BlockSize=20)  # -> Domain, Mesh; disabled
demesh_8 = DeconstructMesh(Mesh=geo)  # -> flatten(Vertices), flatten(Faces), Colours, Normals; disabled

button = Button()  # disabled
panel_21 = Panel("C:\5_PressureOnBuildingFacade")  # disabled
toggle = BooleanToggle(False)  # disabled
number_slider_31 = Slider(6, range=0..10)  # disabled
panel_22 = Panel("3")  # disabled
mset = MeshSettings(AccBuilding=2, AccFeatures=panel_22, AccBBox=0, AccGround=panel_22, MiscSettings=1, NumberOfLayers=4, Mode=2)  # disabled
panel_23 = Panel("1")  # disabled
panel_24 = Panel("20")  # disabled
panel_25 = Panel("-1")  # disabled
rset = RunSettings(
    NumberOfIterations=panel_24,
    WriteInterval=panel_23,
    NumberOfTimestepsToKeep=3,
    TurbulenceModel=1,
    RelaxationFactors=3,
    SolutionAndAlgorithmControl=1,
    PotentialFoamInitialization=False,
    AgeOfAir=False,
    NumberOfCPUs=number_slider_31,
    OperatingSystem=0)  # disabled
simulation = Simulation(
    SimulationDomain=domaincyl.Domain,
    WorkingDirectory=panel_21,
    MeshSettings=mset,
    RunSettings=rset,
    RunMeshing=False,
    MakeTrees=False,
    RunSimulation=toggle,
    runWithBlueCFD=True)  # disabled
residuals = Residuals(Result=simulation, SelectionOfWindDirections=item_19, X=":", Y=":", Version=1, Run=button, visResiduals=True)  # disabled

probing = Probing(BuildingMesh=geo, Points=demesh_8.Vertices)  # disabled
split_4 = SplitList(List=probing, Index=number_slider_12)  # -> ListA, ListB; disabled

# ----
# 4.2. Probing points & probing
panel_26 = Panel("pressure100")  # disabled
toggle_2 = BooleanToggle(False)  # disabled
visprobes = VisualizeProbes(Result=simulation, ProbingPoints=demesh_8.Vertices, NameOfInstance=panel_26, NameOfField=1, Run=toggle_2)  # -> PorbingPoints, ProbingResult; disabled

facen_3 = FaceNormals(Mesh=geo)  # -> Centers, Normals; disabled
cullpt = CullDuplicates(Points=split_4.ListB, Tolerance=0.1, CullMode=1)  # -> Points, Indices, Valence; disabled
partition_2 = PartitionList(List=split_4.ListA, Size=number_slider_13)  # disabled

# ----
# 5. Post-processing
number_slider_32 = Slider(0.7, range=0..1)  # disabled
bnd_6 = Bounds(Numbers=visprobes.ProbingResult)  # disabled
dedomain_4 = DeconstructDomain(Domain=bnd_6)  # -> Start, End; disabled
multiplication_5 = Multiplication(A=dedomain_4.End, B=number_slider_32)  # disabled
gradient_12 = Gradient(
    LowerLimit=-1,
    UpperLimit=multiplication_5,
    Parameter=visprobes.ProbingResult,
    stops=[0: RGB(48, 18, 59), 0.0312: RGB(57, 41, 114), 0.0625: RGB(64, 64, 161), 0.0938: RGB(68, 86, 199), 0.125: RGB(70, 107, 227), 0.156: RGB(70, 127, 246)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])  # disabled
number_slider_33 = Slider(5, range=0..10)  # disabled
number_slider_34 = Slider(5, range=0..10)  # disabled
conmesh_16 = ConstructMesh(Vertices=demesh_8.Vertices, Faces=demesh_8.Faces, Colours=gradient_12)  # disabled
mblur_8 = BlurMesh(Mesh=conmesh_16, Iterations=number_slider_33)  # disabled
branch_36 = TreeBranch(Tree=simplify(graft(item_19)), Path=number_slider_34, MaintainPaths=True)  # disabled
branch_37 = TreeBranch(Tree=mblur_8, Path=number_slider_34, MaintainPaths=True)  # disabled
panel_27 = Panel(branch_36)  # disabled

# ----
# 6. Clean
button_2 = Button()  # disabled
clean_8 = Clean(Directory=simulation, Mode=2, Run=button_2)  # disabled

rad = Radians(Degrees=panel_27)  # disabled
popgeo = PopulateGeometry(Geometry=branch_37, Count=100, Seed=1)  # disabled
avr_10 = Average(Input=popgeo)  # disabled
vec = VectorXYZ(XComponent=0, YComponent=0, ZComponent=0)  # -> Vector, Length; disabled
line = LineSDL(Start=avr_10, Direction=Vector(1, 0, 0), Length=100)  # disabled
rotate = Rotate(Geometry=line, Angle=rad, Plane=avr_10)  # -> Geometry, Transform; disabled
vdisex_2 = VectorDisplayEx(Point=avr_10, Vector=rotate.Geometry, Colour=RGB(0, 0, 0), Width=2)  # disabled
